# Grasshopper definition gh-ground-truth.ghx (Grasshopper 1.0.7)
# plug-ins: Docofossor

design = GhPythonScript()  # -> out, c_toolpaths, gh_toolpaths
# ---------- design: Python ----------
import compas_ghpython as cgh
import compas.geometry as cg
import random as r

xmax = 1135
ymin = -737
zmax = 100
offset = 125
num_crv = 1
length = 50


def generate_toolpaths():
    toolpaths = []
    for i in range(num_crv):
        x_coord = r.randint(offset, xmax-offset)
        y_coord = r.randint(ymin+offset, 0-offset)
        z_coord = r.randint(50, zmax)
        pt = cg.Point(x_coord, y_coord, z_coord)
        
        delta = r.random()
        vec = cg.Vector(0, length, 0)
        
        T = cg.Translation.from_vector(vec)
        pt_end = pt.transformed(T)
        
        pl = cg.Polyline([pt, pt_end])
        toolpaths.append(pl)
    return toolpaths


def draw_toolpaths(c_toolpaths):
    gh_toolpaths = []
    for tp in c_toolpaths:
        artist = cgh.artists.PolylineArtist(tp)
        pl = artist.draw()[0]
        gh_toolpaths.append(pl)
    return gh_toolpaths


c_toolpaths = generate_toolpaths()
gh_toolpaths = draw_toolpaths(c_toolpaths)
# ---------- end design ----------
design_iteration = Panel("0")
compas_toolpaths = Data(design.c_toolpaths)
sandbox = Brep(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)
scan = GhPythonScript(
    activate=Toggle(False),
    start_proxy=Toggle(False),
    initialise_proxy=Button(),
    toolpaths=compas_toolpaths,
    iteration=design_iteration,
    prediction=Toggle(False),
    show_hm=Toggle(False),
    fix=Button())  # -> out, f, tps; inputs activate: Boolean, start_proxy: Boolean, initialise_proxy: Boolean, toolpaths: list, iteration: Int32, prediction: Boolean, show_hm: Boolean, fix: Boolean
# ---------- scan: Python ----------
from compas_ghpython import unload_modules
from compas_ghpython import artists
unload_modules('groundtruth')
from compas.rpc import Proxy

#proxy=Proxy()
#proxy.stop_server()

interface = None

if activate:
    interface = Proxy('groundtruth.interactive.interface')
    if initialise_proxy:
        interface.restart_server()
    if start_proxy:
        interface.start_server()
    else:
        interface.stop_server()
        
        
if interface and start_proxy:
    predicted_img = None
    if prediction:
        predicted_img = interface.prediction(toolpaths, iteration)
        print(type(predicted_img))
    if show_hm:
        f = interface.get_height_grid(predicted_img)
    if fix:
        interface.fix_design(toolpaths, iteration)
# ---------- end scan ----------
messages = Panel(scan.out)
visualise = GhPythonScript(c_tps=scan.tps)  # -> out, gh_toolpaths; inputs c_tps: list
# ---------- visualise: Python ----------
import compas_ghpython as cgh
import compas.geometry as cg
import random as r


def draw_toolpaths(c_toolpaths):
    gh_toolpaths = []
    for tp in c_toolpaths:
        artist = cgh.artists.PolylineArtist(tp)
        pl = artist.draw()[0]
        gh_toolpaths.append(pl)
    return gh_toolpaths

gh_toolpaths = draw_toolpaths(c_tps)
# ---------- end visualise ----------

# ---- group: height map visualization
dam = DataDam(DataA=scan.f, BufferDelay=10000000, BufferMode=0)
dfimportasc = ImportASC(F=dam)
dfgridmesh = GridMesh(Df=dfimportasc)
coloring_mesh = ColoringMesh(mesh=dfgridmesh)
mesh = Mesh(coloring_mesh)

# ==== cluster ColoringMesh
mesh = ClusterInput()
mesh_2 = Mesh(mesh)
demesh = DeconstructMesh(Mesh=mesh_2)  # -> Vertices, Faces, Colours, Normals
pdecon = Deconstruct(Point=demesh.Vertices)  # -> XComponent, YComponent, ZComponent
bnd = Bounds(Numbers=pdecon.ZComponent)
remap = RemapNumbers(Value=pdecon.ZComponent, Source=bnd, Target=Domain(0, 1))  # -> Mapped, Clipped
frgb = ColourRGBF(Alpha=1, Red=remap.Mapped, Green=remap.Mapped, Blue=remap.Mapped)
mcol = MeshColours(Mesh=mesh_2, Colours=frgb)
M = ClusterOutput(mcol)
